# Dynamo graph create_callout.dyn (Dynamo 2.6.1.8786)
# packages: PyScript 0.0.7

offset = DoubleInput(2)  # graph input
rotate = BoolSelector(true)  # graph input
along_section = BoolSelector(true)  # graph input
along_section_other_side = BoolSelector(false)  # graph input
across_section = BoolSelector(true)  # graph input
tample_view_name_for_plan = StringInput("RC_Script_callout_plan")  # graph input
tample_view_name_for_section = StringInput("RC_Script_callout_section")  # graph input
sheet_create = BoolSelector(true)  # graph input
list_create = List.Create(item0=offset, item1=rotate, item2=along_section, item3=along_section_other_side, item4=across_section, item5=tample_view_name_for_plan, item6=tample_view_name_for_section, item7=sheet_create)
execute = PyScript.Script.Execute(IN=list_create)
log = Watch(execute.output)  # graph output
return_ = Watch(execute.OUT)  # graph output
